# Grasshopper definition data_extract.gh (Grasshopper 1.0.7)
# plug-ins: RhinoCodePluginGH

crv = Curve(<curve referenced from the Rhino model>)
crv_2 = Curve(<curve referenced from the Rhino model>)
crv_3 = Curve(<curve referenced from the Rhino model>)
crv_4 = Curve(<curve referenced from the Rhino model>)
pt = Point(<point referenced from the Rhino model>)
pt_2 = Point(<point referenced from the Rhino model>)
S = Script(curve1=crv_2, curve2=crv_3, obstacles=crv)  # -> out, pts, circles_srf, scores; inputs curve1: Curve, curve2: Curve, obstacles: Curve
# ---------- S: Python ----------
import Rhino.Geometry as geo
# curve 1 전체에 point 생성하기
# 간격은 dist
dist = 1500

bounding_box = curve1.GetBoundingBox(geo.Plane.WorldXY)
print(bounding_box.Min)
min_point = bounding_box.Min
max_point =  bounding_box.Max
x_pt_values = []
y_pt_values = []
x = min_point.X
while x <max_point.X:
    x_pt_values.append(x)
    x+=dist
y = min_point.Y
while y <max_point.Y:
    y_pt_values.append(y)
    y+=dist
pts = [] 
for x_pt_value in x_pt_values:
    for y_pt_value in y_pt_values:
        pts.append(geo.Point3d(x_pt_value, y_pt_value,0))

lines = []
circles = [] 
scores = [] 
for check_pt in pts:
    view_lines = []
    for check_other in pts:
        if check_other !=check_pt:
            line = geo.LineCurve(check_pt,check_other)
            lines.append(line)
            events = geo.Intersect.Intersection.CurveCurve(line, obstacles, 0.001, 0.001)
            if not events.Count:
                view_lines.append(line)
    scores.append(len(view_lines))
    circles.append(geo.Circle(check_pt, dist/2))
height = 10
circles_srf = [ geo.Extrusion.Create(circle.ToNurbsCurve(), height, True) for circle in circles]
max_score = max(scores)
scores = [score*255/max_score for score in scores] 
print(len(scores), len(circles))
# ---------- end S ----------
S_2 = Script(x=crv_4, first_floor_point=pt, module_start_point=pt_2)  # -> out, circles, room_names, circle_centers, rectangles, module_rectangles, rectangles_by_module; inputs x: Curve, first_floor_point: Point3d, module_start_point: Point3d
# ---------- S_2: Python ----------
"""Grasshopper Script"""
import sys
import imp
import Rhino
import os
import types
import locale
print(locale.getlocale())
our_path = "C:\\Users\\User\\Documents\\junglim-start"
sys.path.append(our_path)

def reload_package(package):
    fn = package.__file__
    fn_dir = os.path.dirname(fn) + os.sep
    module_visit = {fn}
    def reload_recursive_ex(module):
        imp.reload(module)
        for module_child in vars(module).values():
            if isinstance(module_child, types.ModuleType):
                fn_child = getattr(module_child, "__file__", None)
                if (fn_child and 
                fn_child.startswith(fn_dir) and 
                fn_child not in module_visit):
                    #print("reloading:", fn_child, "from", module)
                    module_visit.add(fn_child)
                    reload_recursive_ex(module_child)
    reload_recursive_ex(package)

def refresh_modules(kwarg):
    reloading_modules = [module for module in sys.modules if kwarg in module]
    for reloading_module in reloading_modules:
        sys.modules.pop(reloading_module)

#이 폴더 안에 있는 모든 모듈을 삭제한다. 
# funcs라는 폴더 이름은 다른 모듈 이름과 중복되어서 변경합니다.
refresh_modules("fx")
import fx
reload_package(fx)


from fx import extract

#data extract 하여서 dictionary로 변환합니다.
object_dict = extract.extract_data_to_dict()
# A-TEXT, A-AREA 안에 있는 Object들을 꺼냅니다.
# 이 레이어는 각자 다를 수 있겠죠?
text_objects = object_dict["A-TEXT"]

text_geometry_list = extract.filter_texts(text_objects)
area_objects = object_dict["A-AREA"]
area_crv_geometrys = [area_obj.Geometry for area_obj in area_objects] 
# 방 이름과 방 면적을 구성하는 리스트 

pairs = extract.get_room_name_area_pairs(text_geometry_list,area_crv_geometrys )


# pair들에서 설계 자동화를 시작해봅니다. 
print(pairs)

# 0 -> 면적을 묶거나 정렬한다.
# classify
# 1층에 있는 방 리스트 ["피아노 연습실", "화장실 1", "개 화장실", "팬트리", "주방", "거실"]
first_floor_room_list = ["피아노 연습실","화장실 1", "개 화장실", "팬트리", "주방", "거실"]
first_room_pair = [] 
print("\n" + "*"*30 + "START FILTERING "+ "*"*30 +"\n")


# list comprehension
first_room_pair = [pair for pair in pairs if pair[0] in first_floor_room_list]
first_room_pair_2 = []
for pair in pairs:
    if pair[0] in first_floor_room_list:
        first_room_pair_2.append(pair)
second_room_pair = [pair for pair in pairs if pair[0] not in first_floor_room_list]
print(first_room_pair)  

#first_room_pair = [pair for pair in pairs if pair[0] in first_floor_room_list]
#second_room_pair = [pair for pair in pairs if pair[0] not in first_floor_room_list] 

def lambda_express(pair):
    return pair[1]
# sort
print("-"*10)
first_room_pair.sort(key=lambda_express, reverse=True)
print(first_room_pair)

# sort reverse
first_room_pair.sort(key=lambda k : k[1], reverse= True)
print(first_room_pair)
import math
import Rhino.Geometry as geo
"""# 1-> 면적표 -> 동그란 방을 만든다.
circles = [] 
circle_center = first_floor_point
circle_center = first_floor_point
print(first_floor_point)

former_radius = 0
circle_centers = []
room_names = [ room_pair[0] for room_pair  in first_room_pair]

for room_name, room_area in first_room_pair:
    radius = (room_area/math.pi)**(1/2)
    circles.append(geo.Circle(circle_center, radius)) 


max_radius = max([circle.Radius for circle in circles])
print(max_radius)
index = 0 
for  i, circle in enumerate(circles):
    dist = max_radius*2*i
    vec = geo.Vector3d(dist,0,0)
    circle.Translate(vec)
    """
rectangles = []
for room_name, room_area in first_room_pair:
    room_length = room_area **(1/2)
    print(room_length)
    origin_point = first_floor_point
    vec_x = geo.Vector3d(room_length, 0,0)
    vec_y = geo.Vector3d(0,room_length,0)
    pt1 = origin_point + vec_x
    pt2 = origin_point + vec_x + vec_y
    pt3 = origin_point + vec_y
    pt4 = origin_point
    rectangles.append(geo.PolylineCurve([pt1,pt2,pt3,pt4,pt1]))

# 최적의 모듈찾기
# module = [8000, 8100,  8400, 8500] 
module_options = [3000,3500, 4500,5000,5500,6000] 

def evaulate_module(module_option):
    module_area = module_option **2
    area_left_list = []
    for room_name, room_area in first_room_pair:
        area_left = room_area % (module_area/2)
        area_left_list.append(area_left)
    return sum(area_left_list)
module_options_sorted = sorted(module_options , key = evaulate_module)
print("*"*8)
print(module_options_sorted[0])
selected_module = module_options_sorted[0]
rectangles_by_module = []
x_dists = [] 
for room_name, room_area in first_room_pair:
    half_module_count = int(room_area / ((selected_module**2)/2))
    module_count = half_module_count/2

    vec_y = geo.Vector3d(0, selected_module,0)
    vec_x = geo.Vector3d(selected_module * module_count, 0,0)
    origin_point = first_floor_point
    x_dists.append(selected_module * module_count)
    pt1 = origin_point + vec_x
    pt2 = origin_point + vec_x + vec_y
    pt3 = origin_point + vec_y
    pt4 = origin_point
    rectangles_by_module.append(geo.PolylineCurve([pt1,pt2,pt3,pt4,pt1]))
    print(room_name, half_module_count/2)


for i, rectangle in enumerate(rectangles_by_module):
    dist_to_move = 0
    for x in range(i):
        dist_to_move += x_dists[x]
    vec = geo.Vector3d(dist_to_move,0,0)
    rectangle.Translate(vec)
    
"""
# 2 -> 면적표 -> 모듈찾기 모듈설계
module_candidates = [4500,5000,5500,6000]
#evaluate_module 
def evaluate_module(module_size, room_areas):
    # 모듈의 절반 면적과 방 크기 사이의 나머지 값을 구한다.
    rest_areas = [] 
    for room_area in room_areas:
        # module area는 module size 제곱을 2로 나눈 값
        module_area = module_size**2 /2
        rest_area = room_area % module_area
        rest_areas.append(rest_area)
    return sum(rest_areas)

room_areas = [pair[1] for pair in first_room_pair]
module_selected = min(module_candidates, key = lambda module : evaluate_module(module, room_areas))
print(module_selected)

print("*"*9)
module_less_rooms=[] 
room_module_count = {} 
for room_name, room_area in first_room_pair:
    half_module_area = (module_selected**2)/2
    half_module_count = int(room_area / half_module_area)
    module_count = half_module_count/2
    if module_count == 0 :
        module_less_rooms.append((room_name, room_area))
    else:
        room_module_count[room_name] = module_count 


    

module_rectangles = [] 

origin_point = module_start_point
former_size = 0
centers = []
for room_name,module_count in room_module_count.items():
    x_size = module_selected * module_count
    y_size = module_selected
    vec = geo.Vector3d(former_size,0,0)
    origin_point += vec
    former_size = x_size
    
    x_vec = geo.Vector3d(x_size,0,0)
    y_vec = geo.Vector3d(0,y_size,0)
    points = (origin_point,origin_point+x_vec, origin_point+x_vec+y_vec, origin_point+y_vec,origin_point) 
    module_rectangle = geo.PolylineCurve(points)
    centers.append(rectangle.GetBoundingBox(geo.Plane.WorldXY).Center)
    module_rectangles.append(module_rectangle) 

"""
# ---------- end S_2 ----------
S_3 = Script()  # -> out, a
# ---------- S_3: Python ----------
"""Grasshopper Script"""

import sys
import os
import locale

locale.setlocale(locale.LC_TIME, 'ko_KR.UTF-8')
print(locale.getlocale())
# ---------- end S_3 ----------
rgb = ColourRGB(Alpha=255, Red=S.scores, Green=S.scores, Blue=S.scores)
pt_3 = Point(S.pts)
material = CreateMaterial(Diffuse=rgb, Specular=RGB(255, 255, 255), Emission=RGB(0, 0, 0), Transparency=0, Shine=0)
tag = TextTag(Location=S_2.circle_centers, Text=S_2.room_names)
crv_5 = Curve(S_2.rectangles_by_module)
preview = CustomPreview(Geometry=S.circles_srf, Material=material)
